# Grasshopper definition 230203_Transform_Entwine.gh (Grasshopper 1.0.7)
# plug-ins: eleFront Rhino 6 Legacy

list = ValueList({"BREP_PARTS", "CRV_GUIDE", "PT_BOLT"}, selected="CRV_GUIDE")
list_2 = ValueList({"BREP_PARTS", "CRV_GUIDE", "PT_BOLT"}, selected="BREP_PARTS")
list_3 = ValueList({"BREP_PARTS", "CRV_GUIDE", "PT_BOLT"}, selected="PT_BOLT")
reflay = ReferenceByLayer(LayerName=list, DisableAutoUpdate=False)
reflay_2 = ReferenceByLayer(LayerName=list_2, DisableAutoUpdate=False)
reflay_3 = ReferenceByLayer(LayerName=list_3, DisableAutoUpdate=False)
getuv = GetUserValue(Geometry=reflay, Key="NUM")
getuv_2 = GetUserValue(Geometry=reflay_2, Key="NUM")
getuv_3 = GetUserValue(Geometry=reflay_3, Key="NUM")
sort = SortList(Keys=getuv, ValuesA=reflay)  # -> Keys, ValuesA
sort_2 = SortList(Keys=getuv_2, ValuesA=reflay_2)  # -> Keys, ValuesA
sort_3 = SortList(Keys=getuv_3, ValuesA=reflay_3)  # -> Keys, ValuesA
partition = PartitionList(List=sort_3.ValuesA, Size="4")

# ---- group: Sorted Point
group = Group(Objects=partition)  # -> flatten(Group)

# ---- group: Sorted_Crv
crv = Curve(sort.ValuesA)

# ---- group: Sorted_Brep 1
brep = Brep(sort_2.ValuesA)

# ----
geo = Geometry(simplify(crv))
end = EndPoints(Curve=geo)  # -> Start, End
vec2pt = Vector2Pt(PointA=end.Start, PointB="0,0,0", Unitize=False)  # -> Vector, Length
move = Move(Geometry=geo, Motion=vec2pt.Vector)  # -> Geometry, Transform
move_2 = Move(Geometry=brep, Motion=vec2pt.Vector)  # -> Geometry, Transform
move_3 = Move(Geometry=group, Motion=vec2pt.Vector)  # -> Geometry, Transform
end_2 = EndPoints(Curve=move.Geometry)  # -> Start, End
vec2pt_2 = Vector2Pt(PointA=end_2.Start, PointB=end_2.End, Unitize=False)  # -> Vector, Length
X = UnitX(Factor=1)
xy = XYPlane(Origin=Point(0, 0, 0))
angle = Angle(VectorA=vec2pt_2.Vector, VectorB=X, Plane=xy)  # -> Angle, Reflex
rotate = Rotate(Geometry=move.Geometry, Angle=angle.Angle, Plane=xy)  # -> Geometry, Transform
rotate_2 = Rotate(Geometry=move_2.Geometry, Angle=angle.Angle, Plane=xy)  # -> Geometry, Transform
rotate_3 = Rotate(Geometry=move_3.Geometry, Angle=angle.Angle, Plane=xy)  # -> Geometry, Transform
lng = ListLength(List=rotate.Geometry)  # -> flatten(Length)
series = Series(Start=0, Step="200", Count=lng)
X_2 = UnitX(Factor=series)
move_4 = Move(Geometry=rotate.Geometry, Motion=X_2)  # -> Geometry, Transform
move_5 = Move(Geometry=rotate_2.Geometry, Motion=X_2)  # -> Geometry, Transform
move_6 = Move(Geometry=rotate_3.Geometry, Motion=X_2)  # -> Geometry, Transform
merge = Merge(Data1=move_4.Geometry, Data2=move_5.Geometry, Data3=move_6.Geometry)
list_4 = ValueList({"BREP_PARTS", "CRV_GUIDE", "PT_BOLT"}, selected="CRV_GUIDE")
list_5 = ValueList({"BREP_PARTS", "CRV_GUIDE", "PT_BOLT"}, selected="BREP_PARTS")
list_6 = ValueList({"BREP_PARTS", "CRV_GUIDE", "PT_BOLT"}, selected="PT_BOLT")
reflay_4 = ReferenceByLayer(LayerName=list_4, DisableAutoUpdate=False)
reflay_5 = ReferenceByLayer(LayerName=list_5, DisableAutoUpdate=False)
reflay_6 = ReferenceByLayer(LayerName=list_6, DisableAutoUpdate=False)
getuv_4 = GetUserValue(Geometry=reflay_4, Key="NUM")
getuv_5 = GetUserValue(Geometry=reflay_5, Key="NUM")
getuv_6 = GetUserValue(Geometry=reflay_6, Key="NUM")
sort_4 = SortList(Keys=getuv_4, ValuesA=reflay_4)  # -> Keys, ValuesA
sort_5 = SortList(Keys=getuv_5, ValuesA=reflay_5)  # -> Keys, ValuesA
sort_6 = SortList(Keys=getuv_6, ValuesA=reflay_6)  # -> Keys, ValuesA
partition_2 = PartitionList(List=sort_6.ValuesA, Size="4")
group_2 = Group(Objects=partition_2)  # -> flatten(Group)

# ---- group: Sorted_Crv
crv_2 = Curve(sort_4.ValuesA)

# ----
# Entwine
entwine = Entwine(Branch00=graft(sort_4.ValuesA), Branch01=graft(sort_5.ValuesA), Branch02=graft(group_2), FlattenInputs=True)

# ----
# Create Matrix
geo_2 = Geometry(simplify(crv_2))
end_3 = EndPoints(Curve=geo_2)  # -> Start, End
vec2pt_3 = Vector2Pt(PointA=end_3.Start, PointB="0,0,0", Unitize=False)  # -> Vector, Length
move_7 = Move(Geometry=geo_2, Motion=vec2pt_3.Vector)  # -> Geometry, Transform
end_4 = EndPoints(Curve=move_7.Geometry)  # -> Start, End
vec2pt_4 = Vector2Pt(PointA=end_4.Start, PointB=end_4.End, Unitize=False)  # -> Vector, Length
X_3 = UnitX(Factor=1)
xy_2 = XYPlane(Origin=Point(0, 0, 0))
angle_2 = Angle(VectorA=vec2pt_4.Vector, VectorB=X_3, Plane=xy_2)  # -> Angle, Reflex
rotate_4 = Rotate(Geometry=move_7.Geometry, Angle=angle_2.Angle, Plane=xy_2)  # -> Geometry, Transform
lng_2 = ListLength(List=rotate_4.Geometry)  # -> flatten(Length)
series_2 = Series(Start=0, Step="200", Count=lng_2)
X_4 = UnitX(Factor=series_2)
move_8 = Move(Geometry=rotate_4.Geometry, Motion=X_4)  # -> Geometry, Transform
merge_2 = Merge(Data1=graft(move_7.Transform), Data2=graft(rotate_4.Transform), Data3=graft(move_8.Transform))
comp = Compound(Transforms=merge_2)  # -> flatten(Compound)

viewer = ParamViewer(entwine)
viewer_2 = ParamViewer(comp)
# Transform
transform = Transform(Geometry=entwine, Transform=comp)
panel = Panel(comp)
bang = ExplodeTree(Data=transform)  # -> Branch0, Branch1, Branch2
ungroup = Ungroup(Group=bang.Branch2)
brep_2 = Brep(graft(bang.Branch1))
crv_3 = Curve(graft(bang.Branch0))
pt = Point(ungroup)
